# Grasshopper definition sum.gh (Grasshopper 1.0.7)
# plug-ins: GHUnitTest

addition = Addition(A=Slider(1, range=0..1), B=Slider(2, range=0..10))
panel = Panel(addition)
serialize = Serialize(N="Sum", V=panel)
